# Grasshopper definition converterscript2.gh (Grasshopper 0.9.76)
# plug-ins: Python Interpreter

panel = Panel("G:\boston_buildings_full_geojson\boston_buildings_full.geojson")
panel_2 = Panel("C:\Users\mackey\Documents\GitHub\BEnMap\resources\5_building_sample.geojson")
panel_3 = Panel("C:\Users\mackey\Documents\GitHub\BEnMap\resources\Energy_Reporting_Data_Sept2016_CLEAN_Original.csv")
panel_4 = Panel("C:\Users\mackey\Documents\GitHub\BEnMap\resources\10_building_sample.geojson")
panel_5 = Panel("G:\Old\hackathon_boston_all_buildings.geojson")
toggle = BooleanToggle(True)
python = PythonScript(energyJsonFile=panel_3, geoJsonFile=panel)  # -> matchedIDs; inputs writeIt: Boolean; disabled
# ---------- python: Python ----------
import os

if energyJsonFile:
    berdoAddresses = []
    berdoCSV = open(energyJsonFile, 'r')
    for lcount, line in enumerate(berdoCSV):
        if lcount > 1:
            try:
                berdAddress = line.split(",")[3].upper()
                berdAddress.replace("AVE.","AV")
                berdAddress.replace("AVE","AV")
                berdAddress.replace("STREET","ST")
                berdAddress.replace("ST.","ST")
                berdAddress.replace("ROAD","RD")
                berdoAddresses.append(berdAddress)
            except:
                pass
    berdoCSV.close()

if geoJsonFile:
    geojson = open(geoJsonFile, 'r')
    
    if writeIt:
        finalJsonFile = open('C:\\Users\\mackey\\Documents\\GitHub\\BEnMap\\resources\\EnergyJson3.geojson', 'wb')
    
    fullTextStr = ""
    for lcount, line in enumerate(geojson):
        if lcount > 5:
            newLine = line.split('null')
            total = ""
            for count, part in enumerate(newLine):
                if count == 0:
                    total = part
                else:
                    total = total + '"Null"' + part
            
            try:
                obj = eval(total)
                address = obj[0]['properties']['PART_ADDRE'].split(',')[0]
                
                if address in berdoAddresses:
                    if writeIt:
                        finalJsonFile.write(line)
                    print address
            except: pass
    
    if writeIt:
        finalJsonFile.close()
    geojson.close()
# ---------- end python ----------
python_2 = PythonScript(energyJsonFile=panel_3)  # -> matchedIDs; inputs writeIt: Boolean
# ---------- python_2: Python ----------
import os

if energyJsonFile:
    berdoAddresses = []
    berdoCSV = open(energyJsonFile, 'r')
    for lcount, line in enumerate(berdoCSV):
        if lcount > 6:
            try:
                berdAddress = line.split(",")[19].upper()
                if berdAddress != "NOT AVAILABLE":
                    berdoAddresses.append(berdAddress)
            except:
                pass
    berdoCSV.close()

if geoJsonFile:
    geojson = open(geoJsonFile, 'r')
    
    if writeIt:
        finalJsonFile = open('C:\\Users\\mackey\\Documents\\GitHub\\BEnMap\\resources\\EnergyJson3.geojson', 'wb')
    
    fullTextStr = ""
    for lcount, line in enumerate(geojson):
        if lcount > 5:
            newLine = line.split('null')
            total = ""
            for count, part in enumerate(newLine):
                if count == 0:
                    total = part
                else:
                    total = total + '"Null"' + part
            
            try:
                obj = eval(total)
                address = obj[0]['properties']['PARCEL_ID'].split(',')[0]
                
                if address in berdoAddresses:
                    if writeIt:
                        finalJsonFile.write(line)
                    print address
            except: pass
    
    if writeIt:
        finalJsonFile.close()
    geojson.close()
# ---------- end python_2 ----------
matchedids = Data(["0504210010", "0602825000", "2101829500", "2101829500", "2101829500", "2101831000"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])
python_3 = PythonScript(energyJsonFile=panel_3, matchedIDs=matchedids)  # -> matched, unmatched; inputs matchedIDs: list
# ---------- python_3: Python ----------
import os

if energyJsonFile:
    berdoAddresses = []
    berdoCSV = open(energyJsonFile, 'r')
    for lcount, line in enumerate(berdoCSV):
        if lcount > 6:
            try:
                berdAddress = line.split(",")[19].upper()
                if berdAddress != "NOT AVAILABLE":
                    berdoAddresses.append(berdAddress)
            except:
                pass
    berdoCSV.close()

matched = []
unmatched = []

for id in berdoAddresses:
    if id in matchedIDs:
        matched.append(id)
    else:
        unmatched.append(id)
# ---------- end python_3 ----------
panel_6 = Panel(python)
