# Grasshopper definition energy_metrics_calc.gh (Grasshopper 0.9.76)
# plug-ins: Python Interpreter, LunchBox

number_slider = Slider(10, range=0..1000)  # disabled
number_slider_2 = Slider(23, range=0..100)  # disabled
toggle = BooleanToggle(True)  # disabled
python = PythonScript(x=number_slider)  # -> a; disabled
# ---------- python: Python ----------
a = range(1,int(x))
print a
# ---------- end python ----------
excelread = ExcelReaderLEGACY(ReadToggle=toggle, Worksheet=1, Column=python, RowStart=1, RowEnd=number_slider_2)  # -> Exceptions, ExcelData; disabled
panel = Panel("\"C:\\\\Users\\\\vasanthakumars\\\\Documents\\\\GitHub\\\\BEnMap\\\\resources\\\\Energy_Reporting_Data_Sept2016_CLEAM.csv\"")
python_2 = PythonScript()  # -> out, a
# ---------- python_2: Python ----------
def open_file(fname):
    try:
        fin = open(fname, 'r')
        data = fin.readlines()
        fin.close()
        return data
    except:
        print 'File %s not opened' % fname
        return False

csvfile = "C:\\Users\\vasanthakumars\\Documents\\GitHub\\BEnMap\\resources\\Energy_Reporting_Data_Sept2016_CLEAM.csv"
lstofbld = open_file(csvfile)
properties = lstofbld.pop(0)
print properties
        

for i,bld in enumerate(lstofbld):
    if True:#i > 4:#abs(i-5.)<0.001:
        lstofinfo = bld.split(',')
        type,use,gfa,eui,energy_star_score,energy_star_cert = 'err','err','err','err','err','err'
        type = lstofinfo[2]
        use = lstofinfo[10]
        gfa = lstofinfo[5]
        eui = lstofinfo[6]
        energy_star_score = lstofinfo[7]
        energy_star_cert = lstofinfo[8]
        year_built = lstofinfo[10]
    
        # Identify the building type
        chktype = False
        
        if "Education" in type:
            mediansrceui = 144.
        elif "College" in type:
            mediansiteeui = 244.
        elif "Food Sales" in type:
            mediansiteeui = 570.
        elif "Convenience" in type:
            mediansiteeui = 657.
        elif "Food Service" in type:
            mediansiteeui = 575. 
        elif "Restaurant" in type:
            mediansiteeui = 434.
        elif "Fast Food" in type:
            mediansiteeui = 1170. 
        elif "Lodging" in type:
            mediansiteeui = 163.
        elif "Mall" in type:
            mediansiteeui = 247. 
        elif "Outpatient" in type:
            mediansiteeui = 163.
        elif "Clinic" in type:
            mediansiteeui = 194.
        elif "Public Assembly" in type:
            mediansiteeui = 89.
        elif "Entertainment" in type:
            mediansiteeui = 94.
        elif "Library" in type:
            mediansiteeui = 246.
        elif "Recreation" in type:
            mediansiteeui = 100.
        elif "Social" in type:
            mediansiteeui = 71.
        elif "Public Order and Safety" in type:
            mediansiteeui = 161.
        elif "Police Station" in type:
            mediansiteeui = 146.
        elif "Vehicle Repair" in type:
            mediansiteeui = 96.
        elif "Storage" in type or "Shipping" in type:
            mediansiteeui = 28.
        elif "Retail Store" in type:
            mediansiteeui = 139.
        else:
            mediansiteeui = 127.
        
        print '--'
        print lstofinfo
        print 'median', mediansiteeui
        print 'energy', eui
        print 'year', year_built
        
        try:
            mediansiteeui = float(mediansiteeui)
            if year_built < 2010:
                print year_built
                energy_target = float(mediansiteeui) * 0.3
            else:
                energy_target = float(mediansiteeui) * 0.8
        except Exception as e:
            energy_target = 'missing eui data target'
            print str(e)
        print 'etarg', energy_target
# ---------- end python_2 ----------
python_3 = PythonScript(x=excelread.ExcelData)  # -> out, a; inputs x: list; disabled
# ---------- python_3: Python ----------
#import csv


def open_file(fname):
    try:
        fin = open(fname, 'r')
        data = fin.readlines()
        fin.close()
        return data
    except:
        print 'File %s not opened' % fname
        return False

def tree2nest(tree):
    nested_lst = []
    for i in range(tree.BranchCount):
        branchList = tree.Branch(i)
        nested_lst.append(branchList)
    return nested_lst

"""
csvfile = "C:\\Users\\vasanthakumars\\Documents\\GitHub\\BEnMap\\resources\\Energy_Reporting_Data_Sept2016_CLEAM.csv"
lstofbld = open_file(csvfile)
"""

lstofbld = []

for index,i in enumerate(stuff):
    rowdata = list(i)
    lstofbld.append(rowdata)
lstofbld.pop(0)
if True:
    for i,bld in enumerate(lstofbld):
        lstofinfo = bld
        print i, lstofinfo
        """
        #print '---'
        type,use,gfa,eui,energy_star_score,energy_star_cert = 'err','err','err','err','err','err'
        if True:#try:
            type = lstofinfo[2]
            use = lstofinfo[10]
            gfa = lstofinfo[5]
            eui = lstofinfo[6]
            energy_star_score = lstofinfo[7]
            energy_star_cert = lstofinfo[8]
            year_built = lstofinfo[10]
        #print '\n'
        print 'pulling', type, '|', use, gfa, energy_star_score, energy_star_cert
        print '----'
        
        # Identify the building type
        chktype = False
        mediansiteeui = 1
        
        if "K-12 School" in type:
            chktype = True
        elif "College" in type:
            mediansiteeui = 104.
            chktype = True
        elif "Food Sales" in type:
            mediansiteeui = 193.
            chktype = True
        elif "Office" in type:
            chktype = True
        elif "Lodging" in type:
            mediansiteeui = 163. 
            chktype = True
        # 
        #print i
        
        if chktype:
            print bld
            print 'median', mediansiteeui
            print 'escore', energy_star_score #score of "simulated" performance vs mediansiteeui
            print 'energy', eui
            print 'eui', eui, 'm', mediansiteeui
            print 'year', year_built
            if year_built < 2010:
                print mediansiteeui * 0.2
  
            else:
                if type(mediansiteeui)==type(0.8):
                    print mediansiteeui * 0.7
            print '--'
        """
# ---------- end python_3 ----------
excelwrite = ExcelWrite(WriteExcelData=False, WorkbookPath=panel, WorksheetName="Sheet1", ClearSheet=False)
